% Simulink data dictionary data_dictionaryy.sldd

F32 = Simulink.AliasType(BaseType="single", HeaderFile="standard_defs.h")
F64 = Simulink.AliasType(BaseType="double", HeaderFile="standard_defs.h")
FLAG = Simulink.AliasType(BaseType="uint8", HeaderFile="standard_defs.h")
MODE = Simulink.AliasType(BaseType="uint8", HeaderFile="standard_defs.h")
S16 = Simulink.AliasType(BaseType="int16", HeaderFile="standard_defs.h")
S8 = Simulink.AliasType(BaseType="int8", HeaderFile="standard_defs.h")
S32 = Simulink.AliasType(BaseType="int32", HeaderFile="standard_defs.h")
U16 = Simulink.AliasType(BaseType="uint16", HeaderFile="standard_defs.h")
U8 = Simulink.AliasType(BaseType="uint8", HeaderFile="standard_defs.h")
U32 = Simulink.AliasType(BaseType="int32", HeaderFile="standard_defs.h")
SMODE = Simulink.AliasType(BaseType="int8", HeaderFile="standard_defs.h")
k_switchrelease_time = Simulink.Parameter(100, StorageClass="ConstVolatile", HeaderFile="tilt_tele_switch_func.h", DefinitionFile="tilt_tele_switch_func_ROM.c", DataType="uint8", Min=0, Max=255, Unit="ms")
k_switchstuck_time = Simulink.Parameter(120, StorageClass="ConstVolatile", HeaderFile="tilt_tele_switch_func.h", DefinitionFile="tilt_tele_switch_func_ROM.c", DataType="uint8", Min=0, Max=255, Unit="ms")
k_switchdebounce_time = Simulink.Parameter(50, StorageClass="ConstVolatile", HeaderFile="tilt_tele_switch_func.h", DefinitionFile="tilt_tele_switch_func_ROM.c", DataType="uint8", Min=0, Max=255, Unit="ms")
Input_Voltage = Simulink.Signal(StorageClass="ImportedExtern", DataType="uint8", Min=0, Max=50, Unit="V", SampleTime=0.01)
Tilt_Tele_Config_Param = Simulink.Signal(StorageClass="ImportedExtern", DataType="boolean", Min=0, Max=1, SampleTime=0.01)
Tilt_Up_Input = Simulink.Signal(StorageClass="ImportedExtern", DataType="boolean", Min=0, Max=1, SampleTime=0.01)
Tilt_Down_Input = Simulink.Signal(StorageClass="ImportedExtern", DataType="boolean", Min=0, Max=1, SampleTime=0.01)
Tele_Forward_Input = Simulink.Signal(StorageClass="ImportedExtern", DataType="boolean", Min=0, Max=1, SampleTime=0.01)
Tele_Rearward_Input = Simulink.Signal(StorageClass="ImportedExtern", DataType="boolean", Min=0, Max=1, SampleTime=0.01)
Tilt_Up_Switch_Status = Simulink.Signal(StorageClass="ExportToFile", HeaderFile="tilt_tele_switch_func.h", DefinitionFile="tilt_tele_switch_func_RAM.c", DataType="Enum: TILT_INPUT")

TILT_INPUT = enum(DataScope="Imported", HeaderFile="enum_types.h", DefaultValue="TILT_Up")
  TILT_Up = 1
  TILT_Down = 2
  TILT_Off = 0

TELE_INPUT = enum(DataScope="Imported", HeaderFile="enum_types.h", DefaultValue="TELE_Forward")
  TELE_Forward = 1
  TELE_Rearward = 2
  TELE_Off = 0

Tilt_Down_Switch_Status = Simulink.Signal(StorageClass="ExportToFile", HeaderFile="tilt_tele_switch_func.h", DefinitionFile="tilt_tele_switch_func_RAM.c", DataType="Enum: TILT_INPUT")
Tele_Forward_Switch_Status = Simulink.Signal(StorageClass="ExportToFile", HeaderFile="tilt_tele_switch_func.h", DefinitionFile="tilt_tele_switch_func_RAM.c", DataType="Enum: TELE_INPUT")
Tele_Rearward_Switch_Status = Simulink.Signal(StorageClass="ExportToFile", HeaderFile="tilt_tele_switch_func.h", DefinitionFile="tilt_tele_switch_func_RAM.c", DataType="Enum: TELE_INPUT")
MinVolt = Simulink.Signal(StorageClass="Localizable", DataType="uint8", Min=0, Max=1)
MaxVolt = Simulink.Signal(StorageClass="Localizable", DataType="boolean", Min=0, Max=1)
VMax = Simulink.Signal(StorageClass="ImportedExtern", DataType="uint8", Min=0, Max=255, Unit="V")
VMin = Simulink.Signal(StorageClass="ImportedExtern", DataType="uint8", Min=0, Max=255, Unit="V")
Battery_Voltage = Simulink.Signal(StorageClass="Localizable", DataType="boolean", Min=0, Max=1)
Tilt_Tele_Enabled = Simulink.Signal(StorageClass="Localizable", DataType="boolean", Min=0, Max=1)
Up_Switch_Output = Simulink.Signal(StorageClass="Localizable", DataType="boolean", Min=0, Max=1)
Down_Switch_Output = Simulink.Signal(StorageClass="Localizable", DataType="boolean", Min=0, Max=1)
Forward_Switch_Output = Simulink.Signal(StorageClass="Localizable", DataType="boolean", Min=0, Max=1)
Rearward_Switch_Output = Simulink.Signal(StorageClass="Localizable", DataType="boolean", Min=0, Max=1)
Tilt_Up_Stuck_Switch = Simulink.Signal(StorageClass="ImportedExtern", DataType="boolean", Min=0, Max=1)
Tilt_Down_Stuck_Switch = Simulink.Signal(StorageClass="ImportedExtern", DataType="boolean", Min=0, Max=1)
Tele_Forward_Stuck_Switch = Simulink.Signal(StorageClass="ImportedExtern", DataType="boolean", Min=0, Max=1)
Tele_Rearward_Stuck_Switch = Simulink.Signal(StorageClass="ImportedExtern", DataType="boolean", Min=0, Max=1)
Validity_Signal = Simulink.Signal(StorageClass="Localizable", DataType="boolean", Min=0, Max=1)
Up_Status = Simulink.Signal(StorageClass="Localizable", DataType="Enum: TILT_INPUT")
Down_Status = Simulink.Signal(StorageClass="Localizable", DataType="Enum: TILT_INPUT")
Forward_Status = Simulink.Signal(StorageClass="Localizable", DataType="Enum: TELE_INPUT")
Rearward_Status = Simulink.Signal(StorageClass="Localizable", DataType="Enum: TELE_INPUT")
Tilt_Up_Switch_Status_Delay = Simulink.Signal(StorageClass="Localizable", DataType="Enum: TILT_INPUT")
Tilt_Down_Switch_Status_Delay = Simulink.Signal(StorageClass="Localizable", DataType="Enum: TILT_INPUT")
Tele_Forward_Switch_Status_Delay = Simulink.Signal(StorageClass="Localizable", DataType="Enum: TELE_INPUT")
Tele_Rearward_Switch_Status_Delay = Simulink.Signal(StorageClass="Localizable", DataType="Enum: TELE_INPUT")
Up_Switch_stuck_time = Simulink.Signal(StorageClass="ImportedExtern", DataType="uint8", Min=0, Max=255)
Up_Switch_debounce_time = Simulink.Signal(StorageClass="ImportedExtern", DataType="uint8", Min=0, Max=255)
Up_Switch_release_time = Simulink.Signal(StorageClass="ImportedExtern", DataType="uint8", Min=0, Max=255)
Down_Switch_release_time = Simulink.Signal(StorageClass="ImportedExtern", DataType="uint8", Min=0, Max=255)
Down_Switch_stuck_time = Simulink.Signal(StorageClass="ImportedExtern", DataType="uint8", Min=0, Max=255)
Down_Switch_debounce_time = Simulink.Signal(StorageClass="ImportedExtern", DataType="uint8", Min=0, Max=255)
Forward_Switch_stuck_time = Simulink.Signal(StorageClass="ImportedExtern", DataType="uint8", Min=0, Max=255)
Forward_Switch_debounce_time = Simulink.Signal(StorageClass="ImportedExtern", DataType="uint8", Min=0, Max=255)
Forward_Switch_release_time = Simulink.Signal(StorageClass="ImportedExtern", DataType="uint8", Min=0, Max=255)
Rearward_Switch_stuck_time = Simulink.Signal(StorageClass="ImportedExtern", DataType="uint8", Min=0, Max=255)
Rearward_Switch_debounce_time = Simulink.Signal(StorageClass="ImportedExtern", DataType="uint8", Min=0, Max=255)
Rearward_Switch_release_time = Simulink.Signal(StorageClass="ImportedExtern", DataType="uint8", Min=0, Max=255)